# Grasshopper definition mobius.gh (Grasshopper 0.9.76)
# plug-ins: Biomorpher, MeshEdit Components, LunchBox, Weaverbird

# Simple mobius band that is discretised into hexgaonal cells.
# Requires Weaverbird and Lunchbox plug-ins to run.
number_slider = Slider(3, range=0..5)
number_slider_2 = Slider(5, range=2..10)
number_slider_3 = Slider(81, range=29..100)
mobius = MobiusSurface(
    UDivisions=100,
    VDivisions=100,
    RParameter=4,
    TParameter=number_slider,
    Scale=5,
    Domain1=Domain(-3.141592654, 3.141592654),
    Domain2=Domain(-1, 1))
hex = HexagonCells(Surface=mobius, UDivisions=number_slider_3, VDivisions=number_slider_2, TParameter=0.25)  # -> HexagonCells, Centers
number_slider_4 = Slider(0.9996, range=0..1)
number_slider_5 = Slider(0.9041, range=0..1)
number_slider_6 = Slider(0.6554, range=0..1)
number_slider_7 = Slider(6.5, range=0..10)
wbframe = WeaverbirdsPictureFrame(MeshPolylines=hex.HexagonCells, Distance=5, InsetType=0)
wbthicken = WeaverbirdsMeshThicken(MeshCurves=wbframe, Distance=number_slider_7, OffsetType=0)
frgb = ColourRGBF(Alpha=1, Red=number_slider_4, Green=number_slider_6, Blue=number_slider_5)
mcol = MeshColours(Mesh=wbthicken, Colours=frgb)
demesh = DeconstructMesh(Mesh=mcol)  # -> Vertices, Faces, Colours, Normals
number_slider_8 = Slider(0.1, range=0..1)
lng = ListLength(List=demesh.Vertices)
# (Performance 'parameter names'
# will be picked up automatically)
lng_2 = ListLength(List=demesh.Faces)
area = MeshArea(Mesh=mcol)  # -> Area, Centroid
scale = Scale(Geometry=mcol, Center=Point(0, 0, 0), Factor=number_slider_8)  # -> Geometry, Transform
cyl = Cylinder(Base=PlaneXY(0, 0, 0), Radius="2.5", Length=Slider(-15.616, range=-100..0))
mesh_uv = MeshSurface(Surface=cyl, UCount=5, VCount=5, Overhang=True, Equalize=False)
biomorpher = Biomorpher(
    Genome=[number_slider_8, number_slider_2, number_slider_3, number_slider, number_slider_4, number_slider_6, number_slider_5, number_slider_7],
    Geometry=[scale.Geometry, mesh_uv],
    Performance=[lng, lng_2, area.Area])  # -> Clusters, History
