# Grasshopper definition BooleanBoxes.gh (Grasshopper 1.0.7)
# plug-ins: MeshEdit Components, Biomorpher

genes = GenePool(
    Decimals=2,
    Maximum=10,
    Minimum=0,
    Value=[9.545405931, 5.261168738, 6.086292695, 3.503169236, 7.947293397, 1.485716276, 9.042736054, 8.345688056, 6.419464056, 6.233445916])
genes_2 = GenePool(
    Decimals=2,
    Maximum=10,
    Minimum=0,
    Value=[2.572443282, 2.409845277, 6.525865477, 5.836935649, 9.759057703, 1.34928902, 4.459653058, 8.715249982, 3.323021304, 8.946644462])
genes_3 = GenePool(
    Decimals=2,
    Maximum=10,
    Minimum=0,
    Value=[1.232751093, 0.01007418294, 6.259620115, 8.163292775, 4.822890068, 6.151767928, 5.727199977, 9.811180908, 3.664560594, 7.45207662])
genes_4 = GenePool(
    Decimals=2,
    Maximum=10,
    Minimum=0,
    Value=[6.319530781, 9.612997402, 8.977537348, 5.592264194, 8.235217251, 4.782139318, 7.429467338, 1.30888067, 8.194853999, 4.38445152])
genes_5 = GenePool(
    Decimals=2,
    Maximum=10,
    Minimum=0,
    Value=[7.523144986, 6.705647215, 3.394766361, 4.572901374, 1.93389681, 0.4578582235, 9.184586776, 2.06303973, 3.613657222, 5.706951204])
genes_6 = GenePool(
    Decimals=2,
    Maximum=10,
    Minimum=0,
    Value=[3.58804666, 6.784304217, 3.287436416, 0.1789781318, 1.316752084, 9.525331748, 9.001548622, 7.922999919, 8.680279168, 1.805525469])
dom = ConstructDomain(DomainStart=genes, DomainEnd=genes_2)
dom_2 = ConstructDomain(DomainStart=genes_3, DomainEnd=genes_4)
dom_3 = ConstructDomain(DomainStart=genes_5, DomainEnd=genes_6)
box = DomainBox(Base=PlaneXY(0, 0, 0), X=dom, Y=dom_2, Z=dom_3)
bbox = BoundingBox(Content=box, Plane=PlaneXY(0, 0, 0), UnionBox=True)  # -> Box, Box_2
volume = Volume(Geometry=bbox.Box)  # -> Volume, Centroid
scale = Scale(Geometry=bbox.Box, Center=volume.Centroid, Factor="0.9")  # -> Geometry, Transform
number_slider = Slider(168, range=0..254)
number_slider_2 = Slider(232, range=0..254)
number_slider_3 = Slider(65, range=0..254)
sdiff = SolidDifference(BrepsA=scale.Geometry, BrepsB=box)
rgb = ColourRGB(Alpha=255, Red=number_slider, Green=number_slider_2, Blue=number_slider_3)
mesh = MeshBrep(
    Brep=sdiff,
    Settings={GridMaxCount=0, GridMinCount=16, JaggedSeams=False, MaxEdgeLength=0, MinEdgeLength=0.0001, MinTolerance=0, Refine=True, RefineAngle=0, RelativeTolerance=0.65, SimplePlanes=True, Tolerance=0})
mjoin = MeshJoin(Meshes=mesh)
mcol = MeshColours(Mesh=mjoin, Colours=rgb)
# Analyse volume
volume_2 = MeshVolume(Mesh=mcol)  # -> Volume, Centroid
biomorpher = Biomorpher(
    Genome=[genes, genes_2, genes_3, genes_4, genes_5, genes_6, number_slider, number_slider_2, number_slider_3],
    Meshes=mcol,
    Perform=volume_2.Volume)
